# Grasshopper definition combinatory_facade_4.gh (Grasshopper 1.0.7)

# Parameters
surface = Surface([<surface referenced from the Rhino model> x5])
surface_2 = Surface([<surface referenced from the Rhino model> x7])
surface_3 = Surface([<surface referenced from the Rhino model> x10])
surface_4 = Surface([<surface referenced from the Rhino model> x10])
n = Slider(3, range=0..10)
m = Slider(6, range=0..10)

# ----
# vectors
module = Slider(3, range=0..10)
ghpython_script = GhPythonScript(x=m, y=n)  # -> out, flatten(a)
# ---------- ghpython_script: Python ----------
import rhinoscriptsyntax as rs
import ghpythonlib.components as gh

def vector_matrx(module, x ,y ):
    serie_x = gh.Series(0,module,x)
    serie_y = gh.Series(0,module,y)
    factor_x = gh.UnitX(serie_x)
    factor_y = gh.UnitY(serie_y)
    vectors,_ = gh.Move(factor_x,factor_y)
    return vectors
    
a = vector_matrx(module,x,y)
# ---------- end ghpython_script ----------
series = Series(Start=0, Step=module, Count=n)
series_2 = Series(Start=0, Step=module, Count=m)
unit_x = UnitX(Factor=series_2)
unit_z = UnitZ(Factor=series)
move = Move(Geometry=graft(unit_x), Motion=unit_z)  # -> flatten(Geometry), Transform

option_sul = Slider(39, range=0..100)
option_norte = Slider(59, range=0..100)
seed = Slider(7, range=0..10)
module_2 = Slider(3, range=0..10)
number_slider = Slider(3, range=0..10)
# Building
n_2 = Slider(3, range=0..10)
m_2 = Slider(6, range=0..10)
rectangle = Rectangle(Plane=PlaneXY(0, 0, 0), XSize=number_slider, YSize=number_slider, Radius=0)  # -> Rectangle, Length
xy_plane = XYPlane(Origin=Point(0, 0, 0))
ghpython_script_2 = GhPythonScript(
    A=surface,
    B=surface_2,
    C=surface_3,
    D=surface_4,
    n=n,
    m=m,
    option_sul=option_sul,
    option_norte=option_norte,
    seed=seed,
    module=module_2)  # -> opa, phrase_sul, phrase_norte; inputs A: list of Brep, B: list of Brep, C: list of Brep, D: list of Brep, n: Int32, m: Int32, option_sul: Int32, option_norte: Int32, seed: Int32, module: Int32
# ---------- ghpython_script_2: Python ----------
import rhinoscriptsyntax as rs
import ghpythonlib.components as gh
import ghpythonlib.treehelpers as gt
import Rhino as r
import rhinoscriptsyntax as rs
import random as rm


list_objs = [A,B,C,D]
character = ["A","B","C","D"]
matrix = n*m
r_character = []
area_total = 0
opa_sul = 30
opa_norte = 60


def move_to_origem(obj):
    box = rs.BoundingBox(obj)
    bbox =  r.Geometry.Box(r.Geometry.Plane.WorldZX,box)   
    point = gh.DeconstructBrep(bbox)[2][0] 
    origen = gh.ConstructPoint(0,0,0)    
    vector,_ = gh.Vector2Pt(point, origen , True)    
    moved_objs = []
    for i in obj:
        moved_obj,_ = gh.Move(i,vector)
        moved_objs.append(moved_obj)
        
    return moved_objs

def opacity(surface):    
    area,_ = gh.Area(surface)     
    area_t,_  =  gh.MassAddition(area)    
    num = round(((area_t/9)*100),2)
    
    return num

def find_form(trys, opa):
    norte = []
    sul = []
    for x in range(trys):
        r_character = []
        area_total = 0
        #randomic phrase
        for i in range(matrix):
            a = rm.choice(character)
            r_character.append(a)
            
        #calculo da area realtivo a frase randon 
        for j in r_character:
            index = character.index(j)             
            area_total = area_total + opa[index]
            
        #select facade
        media = area_total/matrix    
        if media<opa_sul:
            sul.append(r_character)
            
        elif media> opa_norte:
            norte.append(r_character)
    """        
    #recursão para garantir o minimo de opções
    if  len(norte)<5 or len(sul)<5:
        find_form(trys,opa)"""
        
    return norte, sul

def index_wrap(option, list):
    number  = len(list)
    if option > number:
        number = option % number 
        
    else:
       number  = option
    return number    




opa = [opacity(x) for x in list_objs]
norte, sul = find_form(5000,opa)

phrase_norte = norte[index_wrap(option_norte, norte)]
phrase_sul = sul[index_wrap(option_sul, sul)]

print("sul: ",len(sul))
print("norte: ",len(norte))
# ---------- end ghpython_script_2 ----------
rec = Rectangle({Plane=PlaneXY(18.45842331, 14.86353957, 0), Size=Domain2(u=0..48.51033585, v=0..48.51033585)})
pcen = PolygonCenter(Polyline=rectangle.Rectangle)  # -> CenterV, CenterE
multiplication = Multiplication(A=m_2, B="3")
multiplication_2 = Multiplication(A=n_2, B="3")
box_corners = BoxCorners(Box=rectangle.Rectangle)  # -> CornerA, CornerB, CornerC, CornerD, CornerE, CornerF, CornerG, CornerH
panel = Panel(ghpython_script_2.phrase_norte)
panel_2 = Panel(ghpython_script_2.phrase_sul)
square = Square(Plane=xy_plane, Size="3", ExtentX=m_2, ExtentY=n_2)  # -> Cells, Points
panel_3 = Panel(ghpython_script_2.opa)
series_3 = Series(Start=1, Step=1, Count=Slider(15, range=0..100))
dist = Distance(PointA=box_corners.CornerA, PointB=box_corners.CornerB)
pt = Point(pcen.CenterV)
expression = Expression(x=Slider(0.8589, range=0..1), y=series_3, Expression="x^y")
surface_5 = Surface([<surface referenced from the Rhino model> x5])
surface_6 = Surface([<surface referenced from the Rhino model> x7])
surface_7 = Surface([<surface referenced from the Rhino model> x10])
surface_8 = Surface([<surface referenced from the Rhino model> x10])
rectangle_2 = Rectangle(Plane=PlaneXY(0, 0, 0), XSize=multiplication, YSize=multiplication_2, Radius=0)  # -> Rectangle, Length
unit_z_2 = UnitZ(Factor=Slider(3, range=0..10))
multiplication_3 = Multiplication(A=expression, B=dist)
ghpython_script_3 = GhPythonScript(sul=panel_2, norte=panel, A=surface_5, B=surface_6, C=surface_7, D=surface_8, vec=move.Geometry)  # -> out, phrase, facade_sul, facade_norte; inputs seed: Int32, norte: list, A: Brep, B: Brep, C: Brep, D: Brep, vec: list of Vector3d
# ---------- ghpython_script_3: Python ----------
import rhinoscriptsyntax as rs
import ghpythonlib.components as gh
import ghpythonlib.treehelpers as gt
"""
def order_phrase (seed,letters):
    random_phrase = list(gh.Jitter(letters,1,seed))
    #print(type(random))
    #random_phrase = letters
    return random_phrase[0]
phrase = order_phrase(seed,letters)


print(phrase)"""
def geometry(A,B,C,D,phrase,vec):
    list_breps = []
    for i in phrase: 
        #print(i)
        if i =="A":
            item = A
        elif i =="B":
            item = B
        elif i =="C":
            item = C
        else:
            item = D
            
        list_breps.append(item)
       
    geo,_ = gh.Move(list_breps,vec)
    
    return geo
facade_sul = geometry(A,B,C,D,sul,vec)
facade_norte = geometry(A,B,C,D,norte,vec)
# ---------- end ghpython_script_3 ----------
merge = Merge(Data1=flatten(dist), Data2=flatten(multiplication_3))
line_sdl = LineSDL(Start=square.Points, Direction=expr("x*-1", unit_z_2), Length=unit_z_2)
move_2 = Move(Geometry=ghpython_script_3.facade_norte, Motion=Vector(0, 0, 10))  # -> Geometry, Transform
geometry = Geometry(ghpython_script_3.facade_norte)
shift = ShiftList(List=merge, Shift=1, Wrap="0")
shift_2 = ShiftList(List=merge, Shift="-1", Wrap="0")
scale = Scale(Geometry=rectangle.Rectangle, Center=pt, Factor=expression)  # -> Geometry, Transform
pipe = Pipe(Curve=line_sdl, Radius=Slider(0.25, range=0..1), Caps=0)  # -> simplify(Pipe)
sqrt = SquareRoot(Value="2")
multiplication_4 = Multiplication(A=shift, B=sqrt)
division = Division(A=shift_2, B=multiplication_4)
pi = Pi(Factor="0.25")
acos = ArcCosine(Value=division)
subtraction = Subtraction(A=pi, B=acos)
box_rectangle = BoxRectangle(Rectangle=rectangle_2.Rectangle, Height=multiplication_2)
deconstruct_brep = DeconstructBrep(Brep=box_rectangle)  # -> Faces, Edges, Vertices
list_item = ListItem(List=deconstruct_brep.Faces, Index=Slider(4, range=0..10), Wrap=True)
area = Area(Geometry=list_item)  # -> Area, Centroid
scale_2 = Scale(Geometry=pipe, Center=area.Centroid, Factor=Slider(0.91, range=0..1))  # -> Geometry, Transform
multiplication_5 = Multiplication(A=subtraction, B=series_3)
unit_z_3 = UnitZ(Factor=Slider(0.1, range=0..0.1))
rotate = Rotate(Geometry=scale.Geometry, Angle=multiplication_5, Plane=pt)  # -> Geometry, Transform
extrude = Extrude(Base=rotate.Geometry, Direction=unit_z_3)
