# Grasshopper definition definition_2.gh (Grasshopper 1.0.7)

# ----
# Parameters
seed = Slider(7, range=0..10)
surface = Surface([<surface referenced from the Rhino model> x5])
surface_2 = Surface([<surface referenced from the Rhino model> x7])
surface_3 = Surface([<surface referenced from the Rhino model> x10])
n = Slider(3, range=0..10)
m = Slider(6, range=0..10)
option_sul = Slider(37, range=0..100)
option_norte = Slider(87, range=0..100)
surface_4 = Surface([<surface referenced from the Rhino model> x10])

module = Slider(3, range=0..10)
series = Series(Start=0, Step=module, Count=m)

# ----
# Move to origem
ghpython_script = GhPythonScript(A=surface, B=surface_2, C=surface_3, D=surface_4)  # -> out, a, b, c, d; inputs A: list of Brep, B: list of Brep, C: list of Brep, D: list of Brep
# ---------- ghpython_script: Python ----------
import rhinoscriptsyntax as rs
import ghpythonlib.components as gh
import ghpythonlib.treehelpers as gt
import Rhino as r
import rhinoscriptsyntax as rs

def move_to_origem(obj):
    box = rs.BoundingBox(obj)
    bbox =  r.Geometry.Box(r.Geometry.Plane.WorldZX,box)   
    point = gh.DeconstructBrep(bbox)[2][0]   
    vector = gh.Vector2Pt(point, gh.ConstructPoint(0,0,0), False)
    moved_objs = []
    for i in obj:
        moved_obj,_ = gh.Move(i,vector)
        moved_objs.append(moved_obj)
        print(point)
    return moved_objs
    
a,b,c,d = [move_to_origem(x) for x in [A,B,C,D]]
# ---------- end ghpython_script ----------

ghpython_script_2 = GhPythonScript(
    A=surface,
    B=surface_2,
    C=surface_3,
    D=surface_4,
    n=n,
    m=m,
    Option_sul=option_sul,
    Option_norte=option_norte,
    module=module)  # -> opa; inputs A: list of Brep, B: list of Brep, C: list of Brep, D: list of Brep
# ---------- ghpython_script_2: Python ----------
import rhinoscriptsyntax as rs
import ghpythonlib.components as gh
import ghpythonlib.treehelpers as gt
import Rhino as r
import rhinoscriptsyntax as rs


list_objs = [A,B,C,D]

def move_to_origem(obj):
    box = rs.BoundingBox(obj)
    bbox =  r.Geometry.Box(r.Geometry.Plane.WorldZX,box)   
    point = gh.DeconstructBrep(bbox)[2][0] 
    origen = gh.ConstructPoint(0,0,0)    
    vector,_ = gh.Vector2Pt(point, origen , True)    
    moved_objs = []
    for i in obj:
        moved_obj,_ = gh.Move(i,vector)
        moved_objs.append(moved_obj)
        
    return moved_objs

def porcentagem(surface):    
    area,_ = gh.Area(surface)     
    area_t,_  =  gh.MassAddition(area)    
    num = round(((area_t/9)*100),2)
    
    return num

moved_objs = [move_to_origem(x) for x in list_objs]

opa = [porcentagem(x) for x in moved_objs]
# ---------- end ghpython_script_2 ----------

# ----
# Opacity of surfaces
ghpython_script_3 = GhPythonScript(A=ghpython_script.a, B=ghpython_script.b, C=ghpython_script.c, D=ghpython_script.d)  # -> out, opa_A, opa_B, opa_C, opa_D, opa; inputs A: list of Brep, B: list of Brep, C: list of Brep, D: list of Brep
# ---------- ghpython_script_3: Python ----------
import rhinoscriptsyntax as rs
import ghpythonlib.components as gh
import Rhino.Geometry as rg

def porcentagem(surface):    
    area,_ = gh.Area(surface)     
    area_t,_  =  gh.MassAddition(area)    
    num = round(((area_t/9)*100),2)
    return num

opa =[porcentagem(x) for x in [A,B,C,D]]
opa_A, opa_B, opa_C, opa_D = opa
# ---------- end ghpython_script_3 ----------
panel = Panel(ghpython_script_3.opa_D)
panel_2 = Panel(ghpython_script_3.opa_A)
panel_3 = Panel(ghpython_script_3.opa_B)
panel_4 = Panel(ghpython_script_3.opa_C)

panel_5 = Panel(ghpython_script_2)
voronoi_3d = Voronoi3D()  # -> Cells, Boundary
xy_plane = XYPlane(Origin=Point(0, 0, 0))
square = Square(Plane=xy_plane, Size="3", ExtentX=m, ExtentY=n)  # -> Cells, Points
# Letters of  facades
ghpython_script_4 = GhPythonScript(m=m, n=n, opa=ghpython_script_3.opa, seed=seed, option_sul=option_sul, option_norte=option_norte)  # -> out, area, selected_sul, selected_norte; inputs m: Int32, n: Int32, opa: list, option_sul: Int32, option_norte: Int32
# ---------- ghpython_script_4: Python ----------
import rhinoscriptsyntax as rs
import ghpythonlib.components as gh
import ghpythonlib.treehelpers as gt
import Rhino.Geometry as rg
import random as r

n_matriz = n*m
r_letras = []
area_total = 0

opa_sul = 30
opa_norte = 60
letras = ["A","B","C","D"]

def find_form(trys):
    norte = []
    sul = []
    for x in range(trys):
        r_letras = []
        area_total = 0
        #randomic phrase
        for i in range(n_matriz):
            a = r.choice(letras)
            r_letras.append(a)
            
        #calculo da area realtivo a frase randon 
        for j in r_letras:
            index = letras.index(j)        
            area_total = area_total + opa[index]
            
        #select facade
        media = area_total/n_matriz    
        if media<opa_sul:
            sul.append(r_letras)
            
        elif media> opa_norte:
            norte.append(r_letras)
            

    
    if  len(norte)<5 or len(sul)<5:
        find_form(trys)
    return norte, sul

def index_wrap(option, list):
    number  = len(list)
    if option > number:
        number = option % number 
        print(number)
    else:
       number  = option
    return number
    
    
norte, sul = find_form(5000)
print("sul: ",len(sul))
print("norte: ",len(norte))
selected_norte = norte[index_wrap(option_norte, norte)]
selected_sul = sul[index_wrap(option_sul, sul)]
#sul = gh.TreeBranch(gh.SimplifyTree(gt.list_to_tree(sul),True), option_sul)
# ---------- end ghpython_script_4 ----------
area = Area()  # -> Area, Centroid
multiplication = Multiplication(A=n, B="3")
unit_y = UnitY(Factor=multiplication)
multiplication_2 = Multiplication(A=m, B="3")
# vectors
series_2 = Series(Start=0, Step=module, Count=n)
xz_plane = XZPlane(Origin=Point(0, 0, 0))
rectangle = Rectangle(Plane=PlaneXY(0, 0, 0), XSize=multiplication_2, YSize=multiplication, Radius=0)  # -> Rectangle, Length
unit_y_2 = UnitY(Factor=1)
unit_z = UnitZ(Factor=Slider(3, range=0..10))
unit_z_2 = UnitZ(Factor=series_2)
unit_x = UnitX(Factor=series)
line_sdl = LineSDL(Start=square.Points, Direction=expr("x*-1", unit_z), Length=unit_z)
rectangle_2 = Rectangle(Plane=xz_plane, XSize=multiplication_2, YSize=multiplication, Radius=0)  # -> Rectangle, Length
panel_6 = Panel(ghpython_script_4.selected_sul)
panel_7 = Panel(ghpython_script_4.selected_norte)
curve = Curve()
move = Move(Geometry=graft(unit_x), Motion=unit_z_2)  # -> flatten(Geometry), Transform
pipe = Pipe(Curve=line_sdl, Radius=Slider(0.25, range=0..1), Caps=0)  # -> simplify(Pipe)
boundary_surfaces = BoundarySurfaces(Edges=[rectangle_2.Rectangle, curve])
ghpython_script_5 = GhPythonScript(
    seed=seed,
    phrase_sul=panel_6,
    phrase_norte=panel_7,
    A=ghpython_script.a,
    B=ghpython_script.b,
    C=ghpython_script.c,
    D=ghpython_script.d,
    vec=move.Geometry)  # -> facade_sul, facade_norte; inputs seed: Int32, phrase_sul: list, phrase_norte: list, A: list of Brep, B: list of Brep, C: list of Brep, D: list of Brep, vec: list of Vector3d
# ---------- ghpython_script_5: Python ----------
import rhinoscriptsyntax as rs
import ghpythonlib.components as gh
import ghpythonlib.treehelpers as gt

def vec(module):
    factor_x = gh.Series(_,module,m)
    factor_z = gh.Series(_,module,n)
    vect,_ = gh.Move(factor_x,factor_z)
    
    return vect

def geometry(A,B,C,D,phrase,vec):
    list_breps = []
    for i in phrase: 
        #print(i)
        if i =="A":
            item = A
        elif i =="B":
            item = B
        elif i =="C":
            item = C
        else:
            item = D
            
        list_breps.append(item)
       
    geo,_ = gh.Move(list_breps,vec)
    
    return geo
    
facade_norte = geometry(A,B,C,D,phrase_norte,vec)
facade_sul = geometry(A,B,C,D,phrase_sul,vec)
# ---------- end ghpython_script_5 ----------
# matriz
move_2 = Move(Geometry=ghpython_script_5.facade_norte, Motion=unit_y)  # -> Geometry, Transform
box_rectangle = BoxRectangle(Rectangle=rectangle.Rectangle, Height=multiplication)
deconstruct_brep = DeconstructBrep(Brep=box_rectangle)  # -> Faces, Edges, Vertices
list_item = ListItem(List=deconstruct_brep.Faces, Index=Slider(4, range=0..10), Wrap=True)
area_2 = Area(Geometry=list_item)  # -> Area, Centroid
scale = Scale(Geometry=pipe, Center=area_2.Centroid, Factor=Slider(0.91, range=0..1))  # -> Geometry, Transform
