# Grasshopper definition definition_3.gh (Grasshopper 1.0.7)

# Parameters
surface = Surface([<surface referenced from the Rhino model> x5])
surface_2 = Surface([<surface referenced from the Rhino model> x7])
surface_3 = Surface([<surface referenced from the Rhino model> x10])
surface_4 = Surface([<surface referenced from the Rhino model> x10])
n = Slider(3, range=0..10)
m = Slider(6, range=0..10)
option_sul = Slider(37, range=0..100)
option_norte = Slider(87, range=0..100)
seed = Slider(7, range=0..10)
module = Slider(3, range=0..10)
number_slider = Slider(3, range=0..10)
n_2 = Slider(3, range=0..10)
m_2 = Slider(6, range=0..10)
rectangle = Rectangle(Plane=PlaneXY(0, 0, 0), XSize=number_slider, YSize=number_slider, Radius=0)  # -> Rectangle, Length
xy_plane = XYPlane(Origin=Point(0, 0, 0))
ghpython_script = GhPythonScript(
    A=surface,
    B=surface_2,
    C=surface_3,
    D=surface_4,
    n=n,
    m=m,
    option_sul=option_sul,
    option_norte=option_norte,
    module=module)  # -> opa, phrase_sul, phrase_norte, selected_sul, selected_norte; inputs A: list of Brep, B: list of Brep, C: list of Brep, D: list of Brep, n: Int32, m: Int32, option_sul: Int32, option_norte: Int32, seed: Int32, module: Int32
# ---------- ghpython_script: Python ----------
import rhinoscriptsyntax as rs
import ghpythonlib.components as gh
import ghpythonlib.treehelpers as gt
import Rhino as r
import rhinoscriptsyntax as rs
import random as rm


list_objs = [A,B,C,D]
character = ["A","B","C","D"]
matrix = n*m
r_character = []
area_total = 0
opa_sul = 30
opa_norte = 60


def move_to_origem(obj):
    box = rs.BoundingBox(obj)
    bbox =  r.Geometry.Box(r.Geometry.Plane.WorldZX,box)   
    point = gh.DeconstructBrep(bbox)[2][0] 
    origen = gh.ConstructPoint(0,0,0)    
    vector,_ = gh.Vector2Pt(point, origen , True)    
    moved_objs = []
    for i in obj:
        moved_obj,_ = gh.Move(i,vector)
        moved_objs.append(moved_obj)
        
    return moved_objs

def opacity(surface):    
    area,_ = gh.Area(surface)     
    area_t,_  =  gh.MassAddition(area)    
    num = round(((area_t/9)*100),2)
    
    return num

def find_form(trys, opa):
    norte = []
    sul = []
    for x in range(trys):
        r_character = []
        area_total = 0
        #randomic phrase
        for i in range(matrix):
            a = rm.choice(character)
            r_character.append(a)
            
        #calculo da area realtivo a frase randon 
        for j in r_character:
            index = character.index(j)             
            area_total = area_total + opa[index]
            
        #select facade
        media = area_total/matrix    
        if media<opa_sul:
            sul.append(r_character)
            
        elif media> opa_norte:
            norte.append(r_character)
            
    #recursão para garantir o minimo de opções
    if  len(norte)<5 or len(sul)<5:
        find_form(trys,opa)
        
    return norte, sul

def index_wrap(option, list):
    number  = len(list)
    if option > number:
        number = option % number 
        
    else:
       number  = option
    return number    

def phrase_to_geometry(list_objs,phrase,vec):
    list_breps = []
    for j in phrase:
        index = character.index(j)        
        item = list_objs[index]
        list_breps.append(item)
    geo,_ = gh.Move(list_breps,vec)    
    return geo


moved_objs = [move_to_origem(x) for x in list_objs]
opa = [opacity(x) for x in moved_objs]
norte, sul = find_form(5000,opa)

phrase_norte = norte[index_wrap(option_norte, norte)]
phrase_sul = sul[index_wrap(option_sul, sul)]

selected_norte = phrase_to_geometry(list_objs,phrase_norte,vec)
selected_sul = phrase_to_geometry(list_objs,phrase_sul,vec)



print("sul: ",len(sul))
print("norte: ",len(norte))
# ---------- end ghpython_script ----------
rec = Rectangle({Plane=PlaneXY(18.45842331, 14.86353957, 0), Size=Domain2(u=0..48.51033585, v=0..48.51033585)})
geometry = Geometry(ghpython_script.selected_sul)
pcen = PolygonCenter(Polyline=rectangle.Rectangle)  # -> CenterV, CenterE
multiplication = Multiplication(A=m_2, B="3")
multiplication_2 = Multiplication(A=n_2, B="3")
box_corners = BoxCorners(Box=rectangle.Rectangle)  # -> CornerA, CornerB, CornerC, CornerD, CornerE, CornerF, CornerG, CornerH
square = Square(Plane=xy_plane, Size="3", ExtentX=m_2, ExtentY=n_2)  # -> Cells, Points
series = Series(Start=1, Step=1, Count=Slider(15, range=0..100))
panel = Panel(ghpython_script.phrase_sul)
panel_2 = Panel(ghpython_script.opa)
panel_3 = Panel(ghpython_script.phrase_norte)
dist = Distance(PointA=box_corners.CornerA, PointB=box_corners.CornerB)
pt = Point(pcen.CenterV)
expression = Expression(x=Slider(0.8589, range=0..1), y=series, Expression="x^y")
rectangle_2 = Rectangle(Plane=PlaneXY(0, 0, 0), XSize=multiplication, YSize=multiplication_2, Radius=0)  # -> Rectangle, Length
unit_z = UnitZ(Factor=Slider(3, range=0..10))
multiplication_3 = Multiplication(A=expression, B=dist)
panel_4 = Panel(ghpython_script.selected_sul)
merge = Merge(Data1=flatten(dist), Data2=flatten(multiplication_3))
line_sdl = LineSDL(Start=square.Points, Direction=expr("x*-1", unit_z), Length=unit_z)
shift = ShiftList(List=merge, Shift=1, Wrap="0")
shift_2 = ShiftList(List=merge, Shift="-1", Wrap="0")
scale = Scale(Geometry=rectangle.Rectangle, Center=pt, Factor=expression)  # -> Geometry, Transform
pipe = Pipe(Curve=line_sdl, Radius=Slider(0.25, range=0..1), Caps=0)  # -> simplify(Pipe)
sqrt = SquareRoot(Value="2")
multiplication_4 = Multiplication(A=shift, B=sqrt)
division = Division(A=shift_2, B=multiplication_4)
pi = Pi(Factor="0.25")
acos = ArcCosine(Value=division)
subtraction = Subtraction(A=pi, B=acos)
box_rectangle = BoxRectangle(Rectangle=rectangle_2.Rectangle, Height=multiplication_2)
deconstruct_brep = DeconstructBrep(Brep=box_rectangle)  # -> Faces, Edges, Vertices
list_item = ListItem(List=deconstruct_brep.Faces, Index=Slider(4, range=0..10), Wrap=True)
area = Area(Geometry=list_item)  # -> Area, Centroid
scale_2 = Scale(Geometry=pipe, Center=area.Centroid, Factor=Slider(0.91, range=0..1))  # -> Geometry, Transform
multiplication_5 = Multiplication(A=subtraction, B=series)
unit_z_2 = UnitZ(Factor=Slider(0.1, range=0..0.1))
rotate = Rotate(Geometry=scale.Geometry, Angle=multiplication_5, Plane=pt)  # -> Geometry, Transform
extrude = Extrude(Base=rotate.Geometry, Direction=unit_z_2)
